# Grasshopper definition multiLayerArt.gh (Grasshopper 1.0.7)

pt = ConstructPoint(XCoordinate=0, YCoordinate=0, ZCoordinate=0)
rectangle = Rectangle(Plane=PlaneXY(0, 0, 0), XSize=Slider(38.455, range=0..100), YSize=Slider(10, range=0..10), Radius=0)  # -> Rectangle, Length
vec = VectorXYZ(XComponent=217.66, YComponent=43.87769411, ZComponent=0)  # -> Vector, Length
move = Move(Geometry=rectangle.Rectangle, Motion=vec.Vector)  # -> Geometry, Transform
boundary = BoundarySurfaces(Edges=move.Geometry)

# ---- group: Input curves
crv = Curve([<curve referenced from the Rhino model> x56])
cls = Closed(Curve=crv)  # -> Closed, Periodic
cull = CullPattern(List=crv, CullPattern=cls.Closed)
area = Area(Geometry=cull)  # -> Area, Centroid
number_slider = Slider(0, range=0..100)

# ----
sort = SortList(Keys=area.Area, ValuesA=cull)  # -> Keys, reverse(ValuesA)

# ---- group: Input curves (continued)
larger = LargerThan(FirstNumber=sort.ValuesA, SecondNumber=Slider(10, range=0..2000))  # -> LargerThan, OrEqualTo
cull_2 = CullPattern(List=sort.ValuesA, CullPattern=larger.LargerThan)
cull_i = CullIndex(List=cull_2, Indices=number_slider, Wrap=True)
item = ListItem(List=cull_2, Index=number_slider, Wrap=True)
midpt = CurveMiddle(Curve=cull_i)
points = PointList(Points=midpt, Size=Slider(5, range=0..10))

# ----
bbox = BoundingBox(Content=cull_i, Plane=PlaneXY(0, 0, 0))  # -> Box, Box_2
debox = DeconstructBox(Box=bbox.Box)  # -> Plane, X, Y, Z
item_2 = ListItem(List=cull_i, Index=Slider(2, range=0..10), Wrap=True)
boundary_2 = BoundarySurfaces(Edges=item_2)
join = BrepJoin(Breps=[boundary, boundary_2])  # -> Breps, Closed

# ---- group: Generate cutouts
frame_thickness = Slider(20, range=0..20)
panel = Panel("""[
{"out": [], "in": [0, 16, 51, 34, 15, 32, 12, 49, 13]},
{"out": [], "in": [1, 8, 28, 14, 40, 18, 26, 20, 23, 25, 7, 19, 44, 10]},
{"out": [], "in": [2, 41, 21, 27, 22, 11, 39, 33, 17, 50]},
{"out": [4,6], "in": [31, 37, 36, 38, 35, 42, 24, 48]},
{"out": [9], "in": []},
{"out": [5, 3], "in": [45, 46, 29, 47, 30, 43]},

]""")
bbox_2 = BoundingBox(Content=item, Plane=PlaneXY(0, 0, 0))  # -> Box, Box_2
boundary_3 = BoundarySurfaces(Edges=item)
offset = OffsetCurve(Curve=item, Distance=frame_thickness, Corners=1)
debox_2 = DeconstructBox(Box=bbox_2.Box)  # -> Plane, X, Y, Z
python = GhPythonScript(
    shapes=flatten(cull_i),
    outerFrame=offset,
    innerFrame=boundary_3,
    x=debox_2.X,
    y=debox_2.Y,
    groups=panel,
    tabWidth=Slider(10, range=0..10),
    shapeX=flatten(debox.X),
    shapeY=flatten(debox.Y),
    needsCover="[4, 6, 3]")  # -> out, outlines, numLayer, tabCovers; inputs shapes: list, shapeX: list, shapeY: list
# ---------- python: Python ----------
"""Provides a scripting component.
    Inputs:
        shapes: list of curves in the image
        outerFrame: outer frame of the image (curve)
        innerFrame: inner frame of the image (srf)
        x: inner x dimension of the frame
        y: inner y dimension of the frame
        groups: list of lists specifying which shapes are in each layer, 
            the first in each of the inner list is the outermost shape of that layer
        tabWidth: width of the tabs connecting the shapes to the frame
    Output:
        outlines: outlines for each layer """

__author__ = "xiwe7299"

import rhinoscriptsyntax as rs
from Rhino.Geometry import AreaMassProperties, Line, Brep
from ghpythonlib import treehelpers

def findCurveCentroid(guid):
    curve = rs.coercecurve(guid)
    return AreaMassProperties.Compute(curve).Centroid
    
def connectToClosestEdge(shape):
    edgeFrom = shape.closestEdge.From
    edgeTo = shape.closestEdge.To
    tabEdgeIntersectPtX = 0
    tabEdgeIntersectPtY = 0
    # edge is parallel to Y-axis 
    if edgeFrom[0] == edgeTo[0]:
        tab = rs.AddRectangle(rs.WorldXYPlane(), shape.distanceToClosestEdge, tabWidth)
        ToY = shape.centroid[1]
        ToX = (edgeFrom[0] + shape.centroid[0])/2
        tabEdgeIntersectPtY = shape.centroid[1]
        tabEdgeIntersectPtX = edgeFrom[0]
        tabShowing = max(shape.distanceToClosestEdge - shape.x/2, tabWidth)
    # edge is parallel to X-axis
    else: 
        tab = rs.AddRectangle(rs.WorldXYPlane(), tabWidth, shape.distanceToClosestEdge)
        ToX = shape.centroid[0]
        ToY = (edgeFrom[1] + shape.centroid[1])/2
        tabEdgeIntersectPtY = edgeFrom[1]
        tabEdgeIntersectPtX = shape.centroid[0]
        tabShowing = max(shape.distanceToClosestEdge - shape.y/2, tabWidth)
    translateVector = rs.VectorCreate((ToX, ToY, 0), findCurveCentroid(tab))
    movedTab = rs.CopyObject(tab, translateVector)

    return movedTab, tabShowing, (tabEdgeIntersectPtX, tabEdgeIntersectPtY, 0)
    
class ShapeInFrame:
    def __init__(self, guid, boundingX, boundingY, dimX, dimY):
        self.guid = guid
        self.curve = rs.coercecurve(guid)
        amp = AreaMassProperties.Compute(self.curve)
        self.centroid = amp.Centroid
        self.closestEdge = None 
        self.distanceToClosestEdge = 0
        self.frameX = boundingX
        self.frameY = boundingY
        self.x = dimX.Max - dimX.Min
        self.y = dimY.Max - dimY.Min
        self.frameEdges = [
            Line(self.frameX.Min, self.frameY.Min, 0, self.frameX.Max, self.frameY.Min, 0), 
            Line(self.frameX.Min, self.frameY.Max, 0, self.frameX.Max, self.frameY.Max, 0), 
            Line(self.frameX.Min, self.frameY.Min, 0, self.frameX.Min, self.frameY.Max, 0), 
            Line(self.frameX.Max, self.frameY.Min, 0, self.frameX.Max, self.frameY.Max, 0)
            ]
    
    # returns distance to the edge closest to the centroid of the shape and this edge
    def findClosestEdge(self):
        smallestDist = 1000000
        cloesetEdge = None
        for e in self.frameEdges:
            dist = e.DistanceTo(self.centroid, False)
            if smallestDist >= dist:
                smallestDist = dist
                cloesetEdge = e
        self.closestEdge = cloesetEdge 
        self.distanceToClosestEdge = smallestDist
        return (smallestDist, cloesetEdge)
        

outlinesList = []  
tabCovers = []  
g = eval(groups)
needsCover = eval(needsCover)

# each group represent a layer
for group in g:
    # outer shapes are the ones connected to the frame by tab
    outlinesInLayer = []
    for outerIndex in group["out"]:
        outerShape = ShapeInFrame(shapes[outerIndex], x, y, shapeX[outerIndex], shapeY[outerIndex])
        outerShape.findClosestEdge()
        tab = connectToClosestEdge(outerShape)
        srfs = rs.AddPlanarSrf([tab[0], outerShape.guid])
        if outerIndex in needsCover:
            tabCoverCenter = rs.AddPoint(tab[2])
            tabCovers.append(rs.AddCircle(tabCoverCenter, tab[1]))
        
        #union = rs.BooleanUnion(srfs)
        outlinesInLayer += srfs
    outlinesList.append(outlinesInLayer)
outlines = treehelpers.list_to_tree(outlinesList)
numLayer = len(g)
# ---------- end python ----------

# ----
X = UnitX(Factor=expr("-x", frame_thickness))
move_2 = Move(Geometry=pt, Motion=X)  # -> Geometry, Transform
boundary_4 = BoundarySurfaces(Edges=offset)
ln = Line(StartPoint=pt, EndPoint=move_2.Geometry)
mod = Modulus(A=Slider(6, range=0..10), B=python.numLayer)
textsrf = TextOnSurface(Text=mod, Font="Sans Bold:no Italic:no", Height=5, Depth=0, BaseLine=ln, BaseSurface=boundary_4)
branch = TreeBranch(Tree=simplify(python.outlines), Path=mod, MaintainPaths=True)
rdiff = RegionDifference(CurvesA=item, CurvesB=python.tabCovers)
cover = Group(Objects=[rdiff, offset])
rdiff_2 = RegionDifference(CurvesA=boundary_3, CurvesB=join.Breps)

# ---- group: Generate cutouts (continued)
innershapes = GhPythonScript(shapes=flatten(cull_i), groups=panel, layer=mod)  # -> out, currentLayer; inputs shapes: list, layer: Int32
# ---------- innershapes: Python ----------
"""Provides a scripting component.
    Inputs:
        shapes: list of curves in the image
        groups: list of lists specifying which shapes are in each layer, 
            the first in each of the inner list is the outermost shape of that layer
        layer: index of the current layer
    Output:
        currentLayer: shapes for the current layer"""

__author__ = "xiwe7299"

import rhinoscriptsyntax as rs

currentLayer = []
g = eval(groups)
layerIndex = layer % len(g)

innerShapesInGroup = g[layerIndex]["in"]
currentLayer = [shapes[i] for i in innerShapesInGroup]

print(currentLayer)
# ---------- end innershapes ----------
rdiff_3 = RegionDifference(CurvesA=boundary_3, CurvesB=branch)

# ----
outershapes = GhPythonScript(x=rdiff_3, y=branch)  # -> out, a
# ---------- outershapes: Python ----------
__author__ = "xiwe7299"

import rhinoscriptsyntax as rs

if y != None: 
    a = x 
else:
    a = None
# ---------- end outershapes ----------

# ---- group: Generate cutouts (continued)
group = Group(Objects=[offset, innershapes.currentLayer, outershapes.a, textsrf])
