# Grasshopper definition joints.gh (Grasshopper 1.0.7)

numringsegment = Slider(12, range=0..20)
number_slider = Slider(0.32, range=0..10)
numgroup = Slider(1, range=0..10)
baseringradius = Slider(2, range=0..10)
numlayer = Slider(3, range=0..10)
layerstep = Slider(0.25, range=0..5)
series = Series(Start=0, Step=layerstep, Count=numlayer)
series_2 = Series(Start=0, Step=layerstep, Count=numlayer)
rev = ReverseList(List=series_2)
cir = Circle(Plane=PlaneXY(0, 0, 0), Radius=baseringradius)
multiplication = Multiplication(A=numlayer, B=2)
merge = Merge(Data1=series, Data2=rev)
offset = OffsetCurve(Curve=cir, Distance=merge, Corners=1)
divide = DivideCurve(Curve=cir, Count=numringsegment, Kinks=False)  # -> Points, Tangents, Parameters
divide_2 = DivideCurve(Curve=offset, Count=numringsegment, Kinks=False)  # -> Points, Tangents, Parameters
dispatch = Dispatch(List=divide.Points, DispatchPattern=[True, False])  # -> ListA, ListB
dispatch_2 = Dispatch(List=divide_2.Points, DispatchPattern=[True, False])  # -> ListA, ListB
series_3 = Series(Start=0, Step=number_slider, Count=multiplication)
weave = Weave(Pattern=[0, 1], Stream0=dispatch.ListA, Stream1=dispatch_2.ListB, NullGaps=False)
multiplication_2 = Multiplication(A=number_slider, B=numlayer)
Z = UnitZ(Factor=series_3)
nurbs = NurbsCurve(Vertices=weave, Degree=2, Periodic=True)  # -> Curve, Length, Domain
multiplication_3 = Multiplication(A=multiplication_2, B=2)
Z_2 = UnitZ(Factor=multiplication_3)
move = Move(Geometry=flatten(nurbs.Curve), Motion=Z)  # -> Geometry, Transform
multiplication_4 = Multiplication(A=multiplication_3, B=2)
move_2 = Move(Geometry=move.Geometry, Motion=Z_2)  # -> Geometry, Transform
area = Area(Geometry=move_2.Geometry)  # -> Area, Centroid
division = Division(A=6.283185307, B=numringsegment)
rotate = Rotate(Geometry=move_2.Geometry, Angle=division, Plane=area.Centroid)  # -> Geometry, Transform
series_4 = Series(Start=0, Step=multiplication_4, Count=numgroup)
Z_3 = UnitZ(Factor=series_4)
crv = Curve([move.Geometry, rotate.Geometry])
move_3 = Move(Geometry=crv, Motion=graft(Z_3))  # -> flatten(Geometry), Transform
lng = ListLength(List=move_3.Geometry)
range = Range(Domain=Domain(0, 1), Steps=lng)
graph = GraphMapper(
    range,
    x0=0,
    x1=1,
    y0=0,
    y1=1,
    container_name="Bezier",
    cpx=[0, 0.1300110817, 0.7987723947, 1],
    cpy=[0.3223244548, 0.7930392027, 0.7203660011, 0.3616376519])
area_2 = Area(Geometry=move_3.Geometry)  # -> Area, Centroid
multiplication_5 = Multiplication(A=graph, B=Slider(2, range=1..5))
scale = Scale(Geometry=move_3.Geometry, Center=area_2.Centroid, Factor=multiplication_5)  # -> Geometry, Transform
loft = Loft(Curves=scale.Geometry, Options={Adjust=False, Closed=False, LoftEnds=0, LoftSimp=0, LoftType=0, Rebuild=10, Refit=0.01})
cap = CapHoles(Brep=loft)

sph = Sphere(Base=PlaneXY(0, 0, 0), Radius=Slider(10, range=0..10))
geo = Geometry(cap)
box = Box(geo)
debrep = DeconstructBrep(Brep=box)  # -> Faces, Edges, Vertices

# ---- group: Slice along X
item = ListItem(List=debrep.Edges, Index=0, Wrap=True)
numxslice = Slider(8, range=0..20)
item_2 = ListItem(List=debrep.Vertices, Index=0, Wrap=True)
num = Number(item)
X = UnitX(Factor=1)
division_2 = Division(A=num, B=numxslice)
contour = Contour(Shape=geo, Point=expr("x + {0.001, 0, 0}", item_2), Direction=X, Distance=expr("x-0.001", division_2))  # -> flatten(Contours)

# ---- group: Slice along Z
numzslice = Slider(5, range=0..20)
item_3 = ListItem(List=debrep.Edges, Index=Slider(9, range=0..10), Wrap=True)
num_2 = Number(item_3)
Z_4 = UnitZ(Factor=1)
division_3 = Division(A=num_2, B=numzslice)
contour_2 = Contour(Shape=geo, Point=expr("x + {0, 0, 0.001}", item_2), Direction=Z_4, Distance=expr("x-0.001", division_3))  # -> flatten(Contours)

# ---- group: Cull for eligible curves
number_slider_2 = Slider(0, range=0..100)
number_slider_3 = Slider(0, range=0..100)
cull_i = CullIndex(List=contour_2, Indices=number_slider_2, Wrap=True)  # -> reverse(List)
cull_i_2 = CullIndex(List=contour, Indices=number_slider_3, Wrap=True)  # -> reverse(List)
cull_i_3 = CullIndex(List=cull_i, Indices=number_slider_2, Wrap=True)
cull_i_4 = CullIndex(List=cull_i_2, Indices=number_slider_3, Wrap=True)
cls = Closed(Curve=contour)  # -> Closed, Periodic
cls_2 = Closed(Curve=cull_i_3)  # -> Closed, Periodic
cull = CullPattern(List=cull_i_3, CullPattern=cls_2.Closed)
cull_2 = CullPattern(List=cull_i_4, CullPattern=cls.Closed)

# ---- group: Extrude to slices
thickness = Slider(0.16, range=0..1)
Z_5 = UnitZ(Factor=expr("-x/2", thickness))
X_2 = UnitX(Factor=expr("-x/2", thickness))
move_4 = Move(Geometry=cull, Motion=Z_5)  # -> Geometry, Transform
move_5 = Move(Geometry=cull_2, Motion=X_2)  # -> Geometry, Transform
Z_6 = UnitZ(Factor=thickness)
srf = Surface(move_4.Geometry)
X_3 = UnitX(Factor=thickness)
srf_2 = Surface(move_5.Geometry)
extr = Extrude(Base=srf, Direction=Z_6)
extr_2 = Extrude(Base=srf_2, Direction=X_3)

# ---- group: Find slices intersections
crossref = CrossReference(ListA=extr_2, ListB=extr, CrossMode=1)  # -> ListA, ListB
bbx = BrepBrep(BrepA=crossref.ListA, BrepB=crossref.ListB)  # -> Curves, Points
bbox = BoundingBox(Content=bbx.Curves, Plane=PlaneXY(0, 0, 0), UnionBox=True)  # -> Box, Box_2

# ---- group: Create slots
debrep_2 = DeconstructBrep(Brep=bbox.Box)  # -> Faces, Edges, Vertices
item_4 = ListItem(List=debrep_2.Edges, Index=Slider(5, range=0..10), Wrap=True)
num_3 = Number(item_4)
division_4 = Division(A=num_3, B=Slider(2, range=0..10))
Y = UnitY(Factor=division_4)
move_6 = Move(Geometry=bbox.Box, Motion=Y)  # -> Geometry, Transform
move_7 = Move(Geometry=bbox.Box, Motion=expr("-x", Y))  # -> Geometry, Transform
sdiff = SolidDifference(BrepsA=flatten(extr_2), BrepsB=flatten(move_6.Geometry))
sdiff_2 = SolidDifference(BrepsA=flatten(extr), BrepsB=flatten(move_7.Geometry))

# ---- group: Find curves for lasercutting
debrep_3 = DeconstructBrep(Brep=sdiff)  # -> Faces, Edges, Vertices
debrep_4 = DeconstructBrep(Brep=sdiff_2)  # -> Faces, Edges, Vertices
number_slider_4 = Slider(0, range=0..100)
area_3 = Area(Geometry=debrep_3.Faces)  # -> Area, Centroid
area_4 = Area(Geometry=debrep_4.Faces)  # -> Area, Centroid
sort = SortList(Keys=area_3.Area, ValuesA=debrep_3.Faces)  # -> Keys, reverse(ValuesA)
sort_2 = SortList(Keys=area_4.Area, ValuesA=debrep_4.Faces)  # -> Keys, reverse(ValuesA)
item_5 = ListItem(List=sort_2.ValuesA, Index=number_slider_4, Wrap=True)  # -> flatten(Item)
item_6 = ListItem(List=sort.ValuesA, Index=number_slider_4, Wrap=True)  # -> flatten(Item)
cls_3 = Closed(Curve=item_5)  # -> Closed, Periodic
cls_4 = Closed(Curve=item_6)  # -> Closed, Periodic
number_slider_5 = Slider(0.3, range=0..1)
cull_3 = CullPattern(List=item_5, CullPattern=cls_3.Closed)
cull_4 = CullPattern(List=item_6, CullPattern=cls_4.Closed)
area_5 = Area(Geometry=cull_3)  # -> flatten(Area), Centroid
area_6 = Area(Geometry=cull_4)  # -> flatten(Area), Centroid
larger = LargerThan(FirstNumber=area_5.Area, SecondNumber=number_slider_5)  # -> LargerThan, OrEqualTo
larger_2 = LargerThan(FirstNumber=area_6.Area, SecondNumber=number_slider_5)  # -> LargerThan, OrEqualTo
cull_5 = CullPattern(List=cull_3, CullPattern=larger.LargerThan)
cull_6 = CullPattern(List=cull_4, CullPattern=larger_2.LargerThan)

# ----
debrep_5 = DeconstructBrep(Brep=cull_5)  # -> Faces, Edges, Vertices
debrep_6 = DeconstructBrep(Brep=cull_6)  # -> Faces, Edges, Vertices
join = JoinCurves(Curves=debrep_5.Edges, Preserve=False)

# ---- group: Repositioning
area_7 = Area(Geometry=join)  # -> Area, Centroid
repositionforlasercutting = GhPythonScript(curves=flatten(join), centers=flatten(area_7.Centroid), slicing_vector_normal=Z_4)  # -> out, curves_for_lasercutting; inputs curves: list, centers: list
# ---------- repositionforlasercutting: Python ----------
"""Provides a scripting component.
    Inputs:
        curves: collection of slicing curves
        centers: collection of the centers of the curves
        dim_x: collection of the x dimension of the bounding boxes of the curves
        dim_y: collection of the y dimension of the bounding boxes of the curves
        slicing_vector_normal: normal to the slicing planes 
    Output:
        curves_for_lasercutting: output curves on XY plan for lasercutting"""
        

__author__ = "xinwen"

import rhinoscriptsyntax as rs

curves_for_lasercutting = []
index = []
text_height = []
current_x = 0
X_AXIS = [1, 0, 0]
Y_AXIS = [0, 1, 0]
Z_AXIS = [0, 0, 1]

temp = []
temp_2 = []
temp_3 = []

for i in range(len(curves)):
    center = rs.CreatePoint(centers[i])
    curve = curves[i]
    move_vector = rs.VectorCreate((0, 5, 0), center)
    
    # rotate to align the slicing normal with the Z axis
    new_curve = rs.RotateObject(
        curve, center, rs.VectorAngle(slicing_vector_normal, Z_AXIS), rs.VectorCrossProduct(slicing_vector_normal, Z_AXIS), False) 
    # then tranlate the curve to the XY plane 
    new_curve = rs.CopyObject(curve, move_vector)


    curves_for_lasercutting.append(new_curve)
# ---------- end repositionforlasercutting ----------
bbox_2 = BoundingBox(Content=repositionforlasercutting.curves_for_lasercutting, Plane=PlaneXY(0, 0, 0))  # -> Box, Box_2
area_8 = Area(Geometry=repositionforlasercutting.curves_for_lasercutting)  # -> Area, Centroid
debox = DeconstructBox(Box=bbox_2.Box)  # -> Plane, X, Y, Z
python = GhPythonScript(
    curves_for_lasercutting=repositionforlasercutting.curves_for_lasercutting,
    x=debox.X,
    y=debox.Y,
    z=debox.Z,
    centers=area_8.Centroid)  # -> out, temp, repositioned_curves, text, text_height; inputs curves_for_lasercutting: list, x: list, y: list, z: list, centers: list
# ---------- python: Python ----------
__author__ = "xinwen"

import rhinoscriptsyntax as rs

def getDiagnoal(width, length): 
    return (width ** 2 + length ** 2) ** 0.5
    
repositioned_curves = []
text = []
text_height = []
current_x = 0

for i in range(len(curves_for_lasercutting)):
    width = x[i].Max - x[i].Min
    length = y[i].Max - y[i].Min
    center = centers[i]
    move_vector = rs.VectorCreate((current_x, rs.coerce3dpoint(center).Y, 0), center)
    repositioned_curves.append(
        rs.MoveObject(curves_for_lasercutting[i], move_vector))
    text.append(str(i))
    text_height.append(min(min(width, length)/4, 4))
    
    if i + 1 < len(curves_for_lasercutting):
        current_diagnol = getDiagnoal(width, length)
        next_diagnol = getDiagnoal(
            x[i+1].Max - x[i+1].Min,
            y[i+1].Max - y[i+1].Min)
        current_x += (current_diagnol + next_diagnol)/2 + 1
# ---------- end python ----------

# ----
join_2 = JoinCurves(Curves=debrep_6.Edges, Preserve=False)  # -> flatten(Curves)

# ---- group: Repositioning
area_9 = Area(Geometry=join_2)  # -> Area, Centroid
repositionforlasercutting_2 = GhPythonScript(curves=flatten(join_2), centers=flatten(area_9.Centroid), slicing_vector_normal=X_3)  # -> out, curves_for_lasercutting; inputs curves: list, centers: list
# ---------- repositionforlasercutting_2: Python ----------
"""Provides a scripting component.
    Inputs:
        curves: collection of slicing curves
        centers: collection of the centers of the curves
        dim_x: collection of the x dimension of the bounding boxes of the curves
        dim_y: collection of the y dimension of the bounding boxes of the curves
        slicing_vector_normal: normal to the slicing planes 
    Output:
        curves_for_lasercutting: output curves on XY plan for lasercutting"""
        

__author__ = "xinwen"

import rhinoscriptsyntax as rs

curves_for_lasercutting = []
index = []
text_height = []
current_x = 0
X_AXIS = [1, 0, 0]
Y_AXIS = [0, 1, 0]
Z_AXIS = [0, 0, 1]

temp = []
temp_2 = []
temp_3 = []

for i in range(len(curves)):
    center = rs.CreatePoint(centers[i])
    curve = curves[i]
    move_vector = rs.VectorCreate((0, 0, 0), center)
    
    # rotate to align the slicing normal with the Z axis
    new_curve = rs.RotateObject(
        curve, center, rs.VectorAngle(slicing_vector_normal, Z_AXIS), rs.VectorCrossProduct(slicing_vector_normal, Z_AXIS), False) 
    # then tranlate the curve to the XY plane 
    new_curve = rs.CopyObject(curve, move_vector)


    curves_for_lasercutting.append(new_curve)
# ---------- end repositionforlasercutting_2 ----------
bbox_3 = BoundingBox(Content=repositionforlasercutting_2.curves_for_lasercutting, Plane=PlaneXY(0, 0, 0))  # -> Box, Box_2
area_10 = Area(Geometry=repositionforlasercutting_2.curves_for_lasercutting)  # -> Area, Centroid
debox_2 = DeconstructBox(Box=bbox_3.Box)  # -> Plane, X, Y, Z
python_2 = GhPythonScript(
    curves_for_lasercutting=repositionforlasercutting_2.curves_for_lasercutting,
    x=debox_2.X,
    y=debox_2.Y,
    z=debox_2.Z,
    centers=area_10.Centroid)  # -> out, temp, repositioned_curves, text, text_height; inputs curves_for_lasercutting: list, x: list, y: list, z: list, centers: list
# ---------- python_2: Python ----------
__author__ = "xinwen"

import rhinoscriptsyntax as rs

def getDiagnoal(width, length): 
    return (width ** 2 + length ** 2) ** 0.5
    
repositioned_curves = []
text = []
text_height = []
current_x = 0

for i in range(len(curves_for_lasercutting)):
    width = x[i].Max - x[i].Min
    length = y[i].Max - y[i].Min
    center = centers[i]
    move_vector = rs.VectorCreate((current_x, 0, 0), center)
    repositioned_curves.append(
        rs.MoveObject(curves_for_lasercutting[i], move_vector))
    text.append(str(i))
    text_height.append(min(min(width, length)/4, 4))
    
    if i + 1 < len(curves_for_lasercutting):
        current_diagnol = getDiagnoal(width, length)
        next_diagnol = getDiagnoal(
            x[i+1].Max - x[i+1].Min,
            y[i+1].Max - y[i+1].Min)
        current_x += (current_diagnol + next_diagnol)/2 + 1
# ---------- end python_2 ----------

# ----
panel = Panel(python.text)
panel_2 = Panel(python.text_height)
panel_3 = Panel(python.repositioned_curves)

# ---- group: Adding assembly instructions
xy = XYPlane(Origin=Point(0, 0, 0))
boundary = BoundarySurfaces(Edges=python.repositioned_curves)
area_11 = Area(Geometry=python.repositioned_curves)  # -> Area, Centroid
vec = VectorXYZ(XComponent=python.text_height, YComponent=python.text_height, ZComponent=0)  # -> Vector, Length
mirror = Mirror(Geometry=boundary, Plane=xy)  # -> graft(Geometry), Transform
move_8 = Move(Geometry=area_11.Centroid, Motion=vec.Vector)  # -> Geometry, Transform
ln = Line(StartPoint=area_11.Centroid, EndPoint=move_8.Geometry)
textsrf = TextOnSurface(
    Text=python.text,
    Font="Sans Bold:no Italic:no",
    Height=python.text_height,
    Depth=0,
    BaseLine=ln,
    BaseSurface=mirror.Geometry)

# ----
xy_2 = XYPlane(Origin=Point(0, 0, 0))

# ---- group: Adding assembly instructions
xy_3 = XYPlane(Origin=Point(0, 0, 0))
boundary_2 = BoundarySurfaces(Edges=python_2.repositioned_curves)
area_12 = Area(Geometry=python_2.repositioned_curves)  # -> Area, Centroid
vec_2 = VectorXYZ(XComponent=python_2.text_height, YComponent=python_2.text_height, ZComponent=0)  # -> Vector, Length
mirror_2 = Mirror(Geometry=boundary_2, Plane=xy_3)  # -> Geometry, Transform
move_9 = Move(Geometry=area_12.Centroid, Motion=vec_2.Vector)  # -> Geometry, Transform
ln_2 = Line(StartPoint=area_12.Centroid, EndPoint=move_9.Geometry)
textsrf_2 = TextOnSurface(Text=python_2.text, Font="Sans Bold:no Italic:no", Height=python_2.text_height, Depth=0, BaseLine=ln_2, BaseSurface=xy_2)

# ----
geo_2 = Geometry(mirror.Geometry)
panel_4 = Panel(ln)
facen = FaceNormals(Mesh=mirror.Geometry)  # -> Centers, Normals
panel_5 = Panel(facen.Normals)
panel_6 = Panel(mirror.Geometry)
panel_7 = Panel(textsrf)
item_7 = ListItem(List=textsrf, Index=0, Wrap=True)
