# Grasshopper definition slicer.gh (Grasshopper 1.0.7)
# plug-ins: Pancake

# ---- group: rock
python = GhPythonScript(x=Slider(5, range=0..10), y=Slider(10, range=0..10), z=Slider(8, range=0..10), u=Slider(7, range=0..10))  # -> out, a
# ---------- python: Python ----------
__author__ = "xinwen"

import rhinoscriptsyntax as rs
import Rhino
import random

a = []
for i in range(int(z)):
    rect = Rhino.Geometry.Rectangle3d(
        Rhino.Geometry.Plane(
            Rhino.Geometry.Point3d(0, 0, i*u),
            Rhino.Geometry.Vector3d(0, 0, 1)),
        random.uniform(x*(1.1**i), x*2*(1.1**i)), 
        random.uniform(y*(1.1**i), y*2*(1.1**i)))
    rs.MoveObject(
        rect, 
        Rhino.Geometry.Vector3d(
            random.uniform(-x/2, x/2), 
            random.uniform(-y/2, y/2), 
            0))
    a.append(rect)
# ---------- end python ----------
loft = Loft(Curves=python.a, Options={Adjust=False, Closed=False, LoftEnds=0, LoftSimp=0, LoftType=0, Rebuild=10, Refit=0.01})
cap = CapHoles(Brep=loft)
bbox = BoundingBox(Content=cap, Plane=PlaneXY(0, 0, 0))  # -> Box, Box_2
debox = DeconstructBox(Box=bbox.Box)  # -> Plane, X, Y, Z
python_2 = GhPythonScript(x=debox.X, y=debox.Y, z=debox.Z, u=Slider(11, range=1..11), v=Slider(6, range=0..10))  # -> out, a, temp
# ---------- python_2: Python ----------
__author__ = "xinwen"

import rhinoscriptsyntax as rs
import random 
import Rhino

a = []
b = []
for i in range(int(u)):
    p_x = random.uniform(x.Min, x.Max)
    p_y = random.uniform(y.Min, y.Max)
    p_z = random.uniform(z.Min+20, z.Max)
    center = Rhino.Geometry.Point3d(p_x, p_y, p_z);
    radius = random.uniform(v-3, v)
    sphere = Rhino.Geometry.Sphere(center, radius)
    a.append(sphere)
# ---------- end python_2 ----------
sdiff = SolidDifference(BrepsA=cap, BrepsB=python_2.a)

# ---- group: Parametric design
layerstep = Slider(0.25, range=0..5)
baseringradius = Slider(1, range=0..10)
numlayer = Slider(3, range=0..10)
numringsegment = Slider(12, range=0..20)
distance = Slider(0.16, range=0..10)
numgroup = Slider(1, range=0..10)

# ---- group: Parametric design / Create base shape for each layer
series = Series(Start=0, Step=layerstep, Count=numlayer)
series_2 = Series(Start=0, Step=layerstep, Count=numlayer)
cir = Circle(Plane=PlaneXY(0, 0, 0), Radius=baseringradius)
rev = ReverseList(List=series_2)
merge = Merge(Data1=series, Data2=rev)
offset = OffsetCurve(Curve=cir, Distance=merge, Corners=1)
divide = DivideCurve(Curve=cir, Count=numringsegment, Kinks=False)  # -> Points, Tangents, Parameters
divide_2 = DivideCurve(Curve=offset, Count=numringsegment, Kinks=False)  # -> Points, Tangents, Parameters
dispatch = Dispatch(List=divide_2.Points, DispatchPattern=[True, False])  # -> ListA, ListB
dispatch_2 = Dispatch(List=divide.Points, DispatchPattern=[True, False])  # -> ListA, ListB
weave = Weave(Pattern=[0, 1], Stream0=dispatch_2.ListA, Stream1=dispatch.ListB, NullGaps=False)
nurbs = NurbsCurve(Vertices=weave, Degree=2, Periodic=True)  # -> Curve, Length, Domain

# ---- group: Parametric design / Arrange base shapes along Z and rotate
multiplication = Multiplication(A=numlayer, B=2)
series_3 = Series(Start=0, Step=distance, Count=multiplication)
multiplication_2 = Multiplication(A=distance, B=numlayer)
Z = UnitZ(Factor=series_3)
multiplication_3 = Multiplication(A=multiplication_2, B=2)
Z_2 = UnitZ(Factor=multiplication_3)
move = Move(Geometry=flatten(nurbs.Curve), Motion=Z)  # -> Geometry, Transform
move_2 = Move(Geometry=move.Geometry, Motion=Z_2)  # -> Geometry, Transform
area = Area(Geometry=move_2.Geometry)  # -> Area, Centroid
division = Division(A=6.283185307, B=numringsegment)
rotate = Rotate(Geometry=move_2.Geometry, Angle=division, Plane=area.Centroid)  # -> Geometry, Transform
crv = Curve([move.Geometry, rotate.Geometry])

# ---- group: Parametric design / Add more groups
multiplication_4 = Multiplication(A=multiplication_3, B=2)
series_4 = Series(Start=0, Step=multiplication_4, Count=numgroup)
Z_3 = UnitZ(Factor=series_4)
move_3 = Move(Geometry=crv, Motion=graft(Z_3))  # -> flatten(Geometry), Transform

# ---- group: Parametric design / Adjust overrall profile
lng = ListLength(List=move_3.Geometry)
range = Range(Domain=Domain(0, 1), Steps=lng)
graph = GraphMapper(
    range,
    x0=0,
    x1=1,
    y0=0,
    y1=1,
    container_name="Bezier",
    cpx=[0, 0.1300110817, 0.7987723947, 1],
    cpy=[0.3223244548, 0.7930392027, 0.7203660011, 0.3616376519])
area_2 = Area(Geometry=move_3.Geometry)  # -> Area, Centroid
multiplication_5 = Multiplication(A=graph, B=Slider(2, range=1..5))
scale = Scale(Geometry=move_3.Geometry, Center=area_2.Centroid, Factor=multiplication_5)  # -> Geometry, Transform

# ---- group: Parametric design (continued)
loft_2 = Loft(Curves=scale.Geometry, Options={Adjust=False, Closed=False, LoftEnds=0, LoftSimp=0, LoftType=0, Rebuild=10, Refit=0.01})
cap_2 = CapHoles(Brep=loft_2)

# ---- group: Slicing
vec = VectorXYZ(XComponent=Slider(1, range=0..5), YComponent=Slider(0, range=0..5), ZComponent=Slider(0, range=0..5))  # -> Vector, Length
pt = Point(Point(0, 0, 0))
contour = Contour(Shape=cap_2, Point=pt, Direction=vec.Vector, Distance=Slider(0.16, range=0..5))

# ---- group: Culling
cls = Closed(Curve=contour)  # -> Closed, Periodic
cull = CullPattern(List=contour, CullPattern=cls.Closed)
area_3 = Area(Geometry=cull)  # -> Area, Centroid
larger = LargerThan(FirstNumber=area_3.Area, SecondNumber=0.1)  # -> LargerThan, OrEqualTo
cull_2 = CullPattern(List=contour, CullPattern=larger.LargerThan)

# ----
panel = Panel(cls.Closed)

# ---- group: Repositioning curves to XY plane
area_4 = Area(Geometry=cull_2)  # -> Area, Centroid
movetoxyplane = GhPythonScript(curves=flatten(cull_2), centers=flatten(area_4.Centroid), slicing_vector_normal=vec.Vector)  # -> out, curves_for_lasercutting; inputs curves: list, centers: list
# ---------- movetoxyplane: Python ----------
"""Provides a scripting component.
    Inputs:
        curves: collection of slicing curves
        centers: collection of the centers of the curves
        dim_x: collection of the x dimension of the bounding boxes of the curves
        dim_y: collection of the y dimension of the bounding boxes of the curves
        slicing_vector_normal: normal to the slicing planes 
    Output:
        curves_for_lasercutting: output curves on XY plan for lasercutting"""
        

__author__ = "xinwen"

import rhinoscriptsyntax as rs

curves_for_lasercutting = []
index = []
text_height = []
current_x = 0
X_AXIS = [1, 0, 0]
Y_AXIS = [0, 1, 0]
Z_AXIS = [0, 0, 1]

temp = []
temp_2 = []
temp_3 = []

for i in range(len(curves)):
    center = rs.CreatePoint(centers[i])
    curve = curves[i]
    move_vector = rs.VectorCreate((0, 0, 0), center)
    
    # rotate to align the slicing normal with the Z axis
    new_curve = rs.RotateObject(
        curve, center, rs.VectorAngle(slicing_vector_normal, Z_AXIS), rs.VectorCrossProduct(slicing_vector_normal, Z_AXIS), False) 
    # then tranlate the curve to the XY plane 
    new_curve = rs.CopyObject(curve, move_vector)


    curves_for_lasercutting.append(new_curve)
# ---------- end movetoxyplane ----------
bbox_2 = BoundingBox(Content=movetoxyplane.curves_for_lasercutting, Plane=PlaneXY(0, 0, 0))  # -> Box, Box_2
area_5 = Area(Geometry=movetoxyplane.curves_for_lasercutting)  # -> Area, Centroid
debox_2 = DeconstructBox(Box=bbox_2.Box)  # -> Plane, X, Y, Z
repositionforlasercutting = GhPythonScript(
    curves_for_lasercutting=movetoxyplane.curves_for_lasercutting,
    x=debox_2.X,
    y=debox_2.Y,
    z=debox_2.Z,
    centers=area_5.Centroid)  # -> out, temp, repositioned_curves, text, text_height; inputs curves_for_lasercutting: list, x: list, y: list, z: list, centers: list
# ---------- repositionforlasercutting: Python ----------
"""Provides a scripting component.
    Inputs:
        x: the x dimensions of the bbox of the curves
        y: the y dimensions of the bbox of the curves
        z: the z dimensions of the bbox of the curves
    Output:
        repositioned_curves: list of curves repositioned along the x-axis for lasercutting
        text: list of assembly instruction added to the curves 
        text_height: list of heights for text
"""

__author__ = "xinwen"

import rhinoscriptsyntax as rs

def getDiagnoal(width, length): 
    return (width ** 2 + length ** 2) ** 0.5
    
repositioned_curves = []
text = []
text_height = []
current_x = 0

for i in range(len(curves_for_lasercutting)):
    width = x[i].Max - x[i].Min
    length = y[i].Max - y[i].Min
    center = centers[i]
    move_vector = rs.VectorCreate((current_x, 0, 0), center)
    repositioned_curves.append(
        rs.MoveObject(curves_for_lasercutting[i], move_vector))
    text.append(str(i))
    text_height.append(min(min(width, length)/4, 4))
    
    if i + 1 < len(curves_for_lasercutting):
        current_diagnol = getDiagnoal(width, length)
        next_diagnol = getDiagnoal(
            x[i+1].Max - x[i+1].Min,
            y[i+1].Max - y[i+1].Min)
        current_x += (current_diagnol + next_diagnol)/2 + 1
# ---------- end repositionforlasercutting ----------

# ---- group: Adding assembly instructions
xy = XYPlane(Origin=Point(0, 0, 0))
boundary = BoundarySurfaces(Edges=repositionforlasercutting.repositioned_curves)
area_6 = Area(Geometry=repositionforlasercutting.repositioned_curves)  # -> Area, Centroid
mirror = Mirror(Geometry=boundary, Plane=xy)  # -> Geometry, Transform
vec_2 = VectorXYZ(XComponent=repositionforlasercutting.text_height, YComponent=repositionforlasercutting.text_height, ZComponent=0)  # -> Vector, Length
move_4 = Move(Geometry=area_6.Centroid, Motion=vec_2.Vector)  # -> Geometry, Transform
ln = Line(StartPoint=area_6.Centroid, EndPoint=move_4.Geometry)
textsrf = TextOnSurface(
    Text=repositionforlasercutting.text,
    Font="Sans Bold:no Italic:no",
    Height=repositionforlasercutting.text_height,
    Depth=0,
    BaseLine=ln,
    BaseSurface=mirror.Geometry)

# ----
geo = Geometry([repositionforlasercutting.repositioned_curves, textsrf])

# ---- group: Exporting
pcecdxf = DXFExportOption(Scheme=geo, LastSaveLocalization="neutral,N")
pcexportas = ExportAs(
    Geometry=geo,
    FileLocation="/Users/xinwen/Documents/atls-5519-compfab/LA2/slicer.dxf",
    Overwrite=Toggle(True),
    Options=pcecdxf,
    Export=False,
    CompMode=False,
    LastSaveLocalization="neutral,N")  # -> OK, ExportCommand
