# Grasshopper definition GcodeMoveCommand.gh (Grasshopper 1.0.7)
# plug-ins: Pancake

height = Slider(1.2, range=0..10)
build_plate_midpt = Slider(105, range=0..200)
cir = Circle(Plane=PlaneXY(0, 0, 0), Radius=Slider(10, range=0..100))
Z = UnitZ(Factor=height)
extr = Extrude(Base=cir, Direction=Z)
layer_height = Panel("0.3")
filament_diameter = Panel("1.75")
travel_feed_rate = Panel("1000")
extrusion_feed_rate = Panel("300")
nozzle_diameter = Panel("0.4")
pt = ConstructPoint(XCoordinate=0, YCoordinate=0, ZCoordinate=expr("x/2", layer_height))
build_plate_midpt_2 = VectorXYZ(XComponent=build_plate_midpt, YComponent=build_plate_midpt, ZComponent=0)  # -> Vector, Length
cap = CapHoles(Brep=extr)
move = Move(Geometry=cap, Motion=build_plate_midpt_2.Vector)  # -> Geometry, Transform
brep = Brep(move.Geometry)
contour = Contour(Shape=brep, Point=pt, Direction=Vector(0, 0, 1), Distance=layer_height)
bbox = BoundingBox(Content=contour, Plane=PlaneXY(0, 0, 0))  # -> Box, Box_2
extrusion_width = Multiplication(Nozzle_diameter=nozzle_diameter, Width_coeff=1.2)
boundary = BoundarySurfaces(Edges=contour)
debox = DeconstructBox(Box=bbox.Box)  # -> Plane, X, Y, Z
python = GhPythonScript(x=flatten(debox.X), y=flatten(debox.Y), z=flatten(debox.Z), print_width=extrusion_width)  # -> out, lines; inputs x: list, y: list, z: list
# ---------- python: Python ----------
__author__ = "xinwen"

import rhinoscriptsyntax as rs

lines = []

num_contour = len(x) 
for i in range(num_contour): 
    x_range = x[i]
    y_range = y[i]
    for j in range(int((x_range.Max - x_range.Min)/print_width)+1):
        x_pos = x_range.Min+j*print_width
        lines.append(rs.AddLine(
            [x_pos, y_range.Min, z[i].Min], 
            [x_pos, y_range.Max, z[i].Min]))
# ---------- end python ----------
blx = BrepLine(Brep=boundary, Line=python.lines, LimitToFirst=False)  # -> Curves, Points
trim = TrimTree(Tree=blx.Curves, Depth=1)
merge = Merge(Data1=contour, Data2=trim)
line_segment_length = Panel("0.1")
divlength = DivideLength(Curve=merge, Length=line_segment_length)  # -> Points, Tangents, Parameters
pline = PolyLine(Vertices=divlength.Points, Closed=False)
explode = Explode(Curve=pline, Recursive=True)  # -> Segments, Vertices
generate_gcode = GhPythonScript(
    lines=flatten(explode.Segments),
    travel_feed_rate=travel_feed_rate,
    extrusion_feed_rate=extrusion_feed_rate,
    nozzle_diameter=nozzle_diameter,
    layer_height=layer_height,
    filament_diameter=filament_diameter)  # -> out, gcode_output; inputs lines: list of Line
# ---------- generate_gcode: Python ----------
__author__ = "mrivera-cu"

import rhinoscriptsyntax as rs
import math

# CONSTANTS USED BELOW

# GCODE COMMANDS
COMMAND_MOVE = "G1"

# GCODE PARAM Names
PARAM_X = "X"
PARAM_Y = "Y"
PARAM_Z = "Z"
PARAM_E = "E"
PARAM_F = "F"

# Separates params in a command
PARAM_DELIMITER = " "

# Separates commands
COMMAND_DELIMITER = "\n"

# Formatter for param values
NUM_FORMAT = "{value:.3f}"
    
# creates a string consisting of a G1 move command and 
# any associated parameters
def gcode_move(current_pos, next_pos, feed_rate=None, should_extrude=False):
    params = [COMMAND_MOVE]
    # Compare X position and see if we have to move
    if (current_pos[0] != next_pos[0]):
        # we have a different x position so
        # add as a param
        x_param_value = NUM_FORMAT.format(value=next_pos[0])
        x_param_str = PARAM_X + x_param_value
        params.append(x_param_str)
    
    # Compare Y 
    if (current_pos[1] != next_pos[1]):
        # we have a different y position so
        # add as a param
        y_param_value = NUM_FORMAT.format(value=next_pos[1])
        y_param_str = PARAM_Y + y_param_value
        params.append(y_param_str)
    
    # Compare Z
    if (current_pos[2] != next_pos[2]):
        # we have a different z position so
        # add as a param
        z_param_value = NUM_FORMAT.format(value=next_pos[2])
        z_param_str = PARAM_Z + z_param_value
        params.append(z_param_str)
    
    if (feed_rate is not None):
        feed_rate_value = NUM_FORMAT.format(value=feed_rate)
        feed_rate_str = PARAM_F + feed_rate_value
        params.append(feed_rate_str)
        
    if should_extrude:
        distance = rs.Distance(current_pos, next_pos)
        area = (1.2*nozzle_diameter - layer_height) * layer_height + math.pi * (layer_height/2)**2
        v_out = area * distance 
        L = v_out / (math.pi * (filament_diameter/2)**2)
        extrusion_value = NUM_FORMAT.format(value=L)
        extrusion_str = PARAM_E + extrusion_value
        params.append(extrusion_str)
        
    # Make the command from the parameters
    move_command = " ".join(params)
    # Remove excess whitespace on ends
    move_commnad = move_command.strip(" ")
    return move_command
    
# check if two positions are the same     
def is_same_point(current_pos, next_pos):
    if (current_pos[0] == next_pos[0]) and (current_pos[1] == next_pos[1]) and (current_pos[2] == next_pos[2]):
        return True 
    else: 
        return False
        
# Here's the main procedure that uses the functions above

#### WARNING: DO NOT EDIT THE START GCODE! #####
start_gcode_lines = [";START GCODE",
    "M73 P0 R42",
    "M73 Q0 S43",
    "M201 X1000 Y1000 Z200 E5000 ; sets maximum accelerations, mm/sec^2",
    "M203 X200 Y200 Z12 E120 ; sets maximum feedrates, mm / sec",
    "M204 S1250 T1250 ; sets acceleration (S) and retract acceleration (R), mm/sec^2",
    "M205 X8.00 Y8.00 Z0.40 E4.50 ; sets the jerk limits, mm/sec",
    "M205 S0 T0 ; sets the minimum extruding and travel feed rate, mm/sec",
    ";TYPE:Custom",
    "M862.3 P \"MK3S\" ; printer model check",
    "M862.1 P0.4 ; nozzle diameter check",
    "M115 U3.13.1 ; tell printer latest fw version",
    "G90 ; use absolute coordinates",
    "M83 ; extruder relative mode",
    "M104 S215 ; set extruder temp",
    "M140 S60 ; set bed temp",
    "M190 S60 ; wait for bed temp",
    "M109 S215 ; wait for extruder temp",
    "G28 W ; home all without mesh bed level",
    "G80 ; mesh bed leveling",
    "G1 Z0.2 F720",
    "G1 Y-3 F1000 ; go outside print area",
    "G92 E0",
    "G1 X60 E9 F1000 ; intro line",
    "G1 X100 E12.5 F1000 ; intro line",
    "G92 E0",
    "M221 S95",
    "; Don't change E values below. Excessive value can damage the printer.",
    "M907 E538 ; set extruder motor current",
    "G21 ; set units to millimeters",
    "G90 ; use absolute coordinates",
    "M83 ; use relative distances for extrusion",
    "M900 K0.05 ; Filament gcode LA 1.5",
    "M900 K30 ; Filament gcode LA 1.0",
    "M107"]

##### WARNING: DO NOT EDIT THE END GCODE! ######
end_gcode_lines = ["; END Gcode", 
    "M204 S1000", 
    "M107", 
    ";TYPE:Custom", 
    "; Filament-specific end gcode", 
    "G1 Z100 F720 ; Move print head further up", 
    "G1 X0 Y200 F3600 ; park", 
    "G4 ; wait",
    "M221 S100 ; reset flow",
    "M900 K0 ; reset LA",
    "M104 S0 ; turn off temperature",
    "M140 S0 ; turn off heatbed",
    "M107 ; turn off fan",
    "M84 ; disable motors"]


line = lines[0]
origin = [0, 0, 0]
start_pt = line[0]
end_pt = line[1]
gcode_lines = []

# start the print
first_move = gcode_move(origin, start_pt, feed_rate=travel_feed_rate)
gcode_lines.append(first_move)

for i in range(len(lines)):
    line = lines[i]
    gcode_lines.append(gcode_move(line[0], line[1], feed_rate=extrusion_feed_rate, should_extrude=True))
    if (i + 1 < len(lines)):
        next_line = lines[i+1]
        if not is_same_point(line[1], next_line[0]):
            gcode_lines.append(gcode_move(line[1], next_line[0], feed_rate=travel_feed_rate))
    

gcode_output = COMMAND_DELIMITER.join(start_gcode_lines + gcode_lines + end_gcode_lines)
print(gcode_output)
# ---------- end generate_gcode ----------
generate_infill = GhPythonScript()  # -> out, lines; inputs points: tree
# ---------- generate_infill: Python ----------
__author__ = "xinwen"

import rhinoscriptsyntax as rs

lines = []

for i in range(points.BranchCount):
    points_in_layer = points.Branch(i)
    num_points = points_in_layer.Count
    
    for j in range(int(num_points/2)):
        lines.append(rs.AddLine(points_in_layer[j], points_in_layer[num_points-1-j]))
# ---------- end generate_infill ----------
gcode_file = Panel("/Users/xinwen/Documents/atls-5519-compfab/LA3/output.gcode")
panel = Panel(generate_gcode.gcode_output)
pcexporttxt = ExportTXT(
    Content=generate_gcode.gcode_output,
    FileLocation=gcode_file,
    Overwrite=True,
    Encoding="utf-8",
    Export=Toggle(False),
    LastSaveLocalization="neutral,N")
