# Grasshopper definition seat.gh (Grasshopper 1.0.7)

# ---- group: Create seat profile
seat_back_height = Slider(20, range=0..100)
seat_length = Slider(14, range=0..100)
pt = ConstructPoint(XCoordinate=0, YCoordinate=0, ZCoordinate=0)
pt_2 = Point(pt)
X = UnitX(Factor=seat_length)
Z = UnitZ(Factor=seat_back_height)
move = Move(Geometry=pt_2, Motion=Z)  # -> Geometry, Transform
move_2 = Move(Geometry=pt_2, Motion=X)  # -> Geometry, Transform
ln = Line(StartPoint=pt_2, EndPoint=move.Geometry)
ln_2 = Line(StartPoint=pt_2, EndPoint=move_2.Geometry)
join = JoinCurves(Curves=flatten([ln, ln_2]), Preserve=False)
fillet = Fillet(Curve=join, Radius=Slider(16, range=0..100))

# ---- group: Create seat base shape
seat_width = Slider(17, range=0..100)
seat_depth = Slider(2.83, range=0..10)
Y = UnitY(Factor=seat_width)
division = Division(A=Y, B=2)
move_3 = Move(Geometry=fillet, Motion=division)  # -> Geometry, Transform
move_4 = Move(Geometry=pt_2, Motion=division)  # -> Geometry, Transform
vec = VectorXYZ(XComponent=seat_depth, YComponent=0, ZComponent=seat_depth)  # -> Vector, Length
scale = Scale(Geometry=move_3.Geometry, Center=move_4.Geometry, Factor=Slider(1.3, range=0..3))  # -> Geometry, Transform
neg = Negative(Value=vec.Vector)
move_5 = Move(Geometry=fillet, Motion=Y)  # -> Geometry, Transform
move_6 = Move(Geometry=scale.Geometry, Motion=neg)  # -> Geometry, Transform
loft = Loft(
    Curves=[fillet, move_6.Geometry, move_5.Geometry],
    Options={Adjust=False, Closed=False, LoftEnds=0, LoftSimp=0, LoftType=0, Rebuild=10, Refit=0.01})

# ---- group: Create seat
seat_thickness = Slider(1, range=0..1)
offset = OffsetSurface(Surface=loft, Distance=seat_thickness, Retrim=True)
loft_2 = Loft(Curves=[loft, offset], Options={Adjust=False, Closed=False, LoftEnds=0, LoftSimp=0, LoftType=0, Rebuild=10, Refit=0.01})
join_2 = BrepJoin(Breps=[loft_2, loft, offset])  # -> Breps, Closed

# ---- group: Create leg
box = Box(join_2.Breps)
area = Area(Geometry=box)  # -> Area, Centroid
leg_top_radius = Slider(8, range=0..10)
leg_height = Slider(20, range=0..100)
project = Project(Geometry=box, Plane=PlaneXY(0, 0, 0))  # -> Geometry, Transform
project_2 = ProjectPoint(Point=area.Centroid, Direction=Vector(0, 0, -1), Geometry=box)  # -> Point, Index
subtraction = Subtraction(A=seat_thickness, B=Slider(0, range=0..1))
cir = Circle(Plane=project_2.Point, Radius=leg_top_radius)
Z_2 = UnitZ(Factor=subtraction)
Z_3 = UnitZ(Factor=leg_height)
move_7 = Move(Geometry=cir, Motion=Z_2)  # -> Geometry, Transform
neg_2 = Negative(Value=Z_3)
leg_bottom_radius = Slider(10, range=0..20)
leg_middle_scale_factor = Slider(0.8, range=0..1)
division_2 = Division(A=neg_2, B=2)
move_8 = Move(Geometry=move_7.Geometry, Motion=neg_2)  # -> Geometry, Transform
pt_3 = Point(move_8.Geometry)
move_9 = Move(Geometry=cir, Motion=division_2)  # -> Geometry, Transform
cir_2 = Circle(Plane=pt_3, Radius=leg_bottom_radius)
scale_2 = Scale(Geometry=move_9.Geometry, Center=move_9.Geometry, Factor=leg_middle_scale_factor)  # -> Geometry, Transform
loft_3 = Loft(
    Curves=[move_7.Geometry, scale_2.Geometry, cir_2],
    Options={Adjust=False, Closed=False, LoftEnds=0, LoftSimp=0, LoftType=0, Rebuild=10, Refit=0.01})
brep = Brep(loft_3)
cap = CapHoles(Brep=brep)

# ---- group: Add texture to chair
number_slider = Slider(5, range=0..10)
sdivide = DivideSurface(Surface=loft, UCount=number_slider, VCount=number_slider)  # -> Points, Normals, Parameters
lng = ListLength(List=flatten(sdivide.Points))
dom = ConstructDomain(DomainStart=Slider(3, range=0..10), DomainEnd=Slider(6, range=0..10))
random = Random(Range=dom, Number=lng, Seed=2)
sph = Sphere(Base=flatten(sdivide.Points), Radius=random)

# ----
bubbles = Brep(sph)
seat = Brep(join_2.Breps)
sunion = SolidUnion(Breps=[bubbles, seat, cap])
